# Grasshopper definition GHCitySim.ghx (Grasshopper 1.0.7)

select_your_path = Panel("\Documents\GitHub\GHCitySim\resources\CHE_Geneva.067000_IWEC.epw")
select_your_path_2 = Panel("\Documents\GitHub\GHCitySim\simulation")
userdir = GhPythonScript()  # -> userdir
# ---------- userdir: Python ----------
import os
userdir = os.path.expanduser('~')
# ---------- end userdir ----------
userdir_2 = GhPythonScript()  # -> userdir; same code as userdir
join = TextJoin(Text=[userdir_2, select_your_path_2])
join_2 = TextJoin(Text=[userdir, select_your_path])

# ----
# 0. Set initial parameters...
# You can download CitySim solver from
# http://citysim.epfl.ch
# ... and let the bees and bugs fly
path_to_weather_file_epw = Panel(join_2)
name_of_the_simulation = Panel("test")
# GH-CitySim: an interface to CitySim started by Giuseppe Peronato
# 
# © All rights reserved. Ecole polytechnique fédérale de Lausanne (EPFL), Switzerland,
# Laboratory of Integrated Performance in Design (LIPID), 2016-2018
# Developer: Giuseppe Peronato <giuseppe.peronato@alumni.epfl.ch>
# 
# Further development conducted at Uppsala University, Sweden.
# Division of Construction Engineering, 2019
# Developer: Giuseppe Peronato <giuseppe.peronato@angstrom.uu.se>
# 
# CitySim is a software developed and distributed by the
# Laboratory of Solar Energy and Building Physics (LESO-PB)
# http://citysim.epfl.ch/
# 
# Contributors:
# Aymeric Delmas <aymeric.delmas@imageen.re>
# 
# This tool relies on and will hopefully be part of
# Ladybug and Honeybee: two plugins for Environmental Analysis (GPL)
# started by Mostapha Sadeghipour Roudsari
simulation_directory = Panel(join)
path_to_citysim_solver = Panel("C:\CitySim.exe")
honeybee = Honeybee_Honeybee()  # -> Vviiiiiiiiiizzz; plug-in component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
ladybug = Ladybug_Ladybug()  # -> Vviiiiiiiiiizzz; plug-in component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
solver_path = Text(path_to_citysim_solver)
epw_path = FilePath(path_to_weather_file_epw)
name = Text(name_of_the_simulation)
directory = FilePath(simulation_directory)

# ----
# 1. Import Geometry
# In order to ceate HoneyBee zones, make sure you use closed breps only.
select_breps_to_simulate = Panel("""0
1
2""")
brep = Brep([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])
item = ListItem(List=brep, Index=select_breps_to_simulate, Wrap=True)
intersectmass = Honeybee_IntersectMasses(bldgMassesBefore=flatten(item))  # -> bldgMassesAfter; plug-in component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
panel = Panel(brep)
brep_2 = Brep(intersectmass)
panel_2 = Panel(brep_2)

meshresolution = Slider(4, range=0..10)
custom_mesh_settings = SettingsCustom(
    StitchSeams=False,
    SimplePlanes=False,
    Refine=True,
    MinCount=0,
    MaxCount=0,
    AspectRatio=20,
    MaxDistance=0,
    MaxAngle=20,
    MinEdge=meshresolution,
    MaxEdge=meshresolution)
mesh = MeshBrep(Brep=intersectmass, Settings=custom_mesh_settings)
faceb = FaceBoundaries(Mesh=mesh)
join_3 = BrepJoin(Breps=faceb)  # -> flatten(Breps), Closed

# ----
# 1. Set Weather File
button = Button()
path = FilePath(directory)
epw_path_2 = FilePath(epw_path)
epw_to_cli = Honeybee_EpwToCli(epwFile=epw_path_2, dir=path, Run=button)  # -> out, CSobj; plug-in component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

# ----
# 3. Define schedules
# Occupancy is mandatory for thermal simulations.
# This component is still very limited (WIP).
daily_occupation_ratios = Panel("""1
1
1
1
1
1
1
1
1
1
1
1
1
1
1
1
1
1
1
1
1
1
1
1""")
name_2 = Text(name)
directory_2 = FilePath(directory)
citysim_schedules = Honeybee_CitySimSchedules(dir=directory_2, day=daily_occupation_ratios, name=name_2, Write=Button())  # -> out, CSobj; plug-in component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

obstruction_mesh = Mesh(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)

# ----
# 2. Define obstructions
horiziontal = Panel("""0
90
180
270
360""")
vertical = Panel("""10
10
10
10
10""")
terrain_mesh = Mesh(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)
name_3 = Text(name)
directory_3 = FilePath(directory)
directory_4 = FilePath(directory)
name_4 = Text(name)
false = Boolean(False)
directory_5 = FilePath(directory)
name_5 = Text(name)
citysim_srf = Honeybee_CitySimSrf(S=obstruction_mesh, R=Slider(0.2, range=0..1), dir=directory_3, name=name_3, Write=Button())  # -> out, CSobj; plug-in component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
citysim_srf_2 = Honeybee_CitySimSrf(S=terrain_mesh, R=Slider(0.1, range=0..1), type="terrain", Dup=false, dir=directory_4, name=name_4, Write=Button())  # -> out, CSobj; plug-in component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
citysim_horizon = Honeybee_CitySimHorizon(H=horiziontal, V=vertical, dir=directory_5, name=name_5, Write=Button())  # -> out, CSobj; plug-in component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

csobjs = Data([citysim_horizon.CSobj, citysim_srf_2.CSobj, citysim_srf.CSobj, citysim_schedules.CSobj, epw_to_cli.CSobj])
preview = CustomPreview(Geometry=terrain_mesh, Material=ColourSwatch(SwatchColor=RGB(153, 129, 129)))
preview_2 = CustomPreview(Geometry=obstruction_mesh, Material=ColourSwatch(SwatchColor=RGB(153, 153, 153)))

# ----
# HoneyBee zones:
# Activate components before running the simulation
number_slider = Slider(80, range=0..100)
reflectivity = Slider(0.2, range=0..1)
u_value = Slider(0.17, range=0..1)
u_value_2 = Slider(0.25, range=0..1)
buildings_breps = Brep(join_3.Breps)
number_slider_2 = Slider(0.036, range=0..0.1)
number_slider_3 = Slider(0.14, range=0..1)
number_slider_4 = Slider(0.036, range=0..0.1)
number_slider_5 = Slider(0.21, range=0..1)
one_over_x = OneOverX(Value=u_value)
one_over_x_2 = OneOverX(Value=u_value_2)
separatebynormal = Honeybee_SeparateByNormal(geometry=buildings_breps, maxUpDecAngle=number_slider, maxDownDecAngle=number_slider)  # -> simplify(lookingUp), simplify(lookingDown), simplify(lookingSide); plug-in component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
division = Division(A=number_slider_2, B=number_slider_3)
division_2 = Division(A=number_slider_4, B=number_slider_5)
epopaquemat = Honeybee_EnergyPlusOpaqueMaterial(
    name="SIA380_insulation_ground",
    thickness=number_slider_3,
    conductivity=number_slider_2,
    density=Slider(35, range=0..100),
    specificHeat=Slider(1450, range=0..10000),
    solAbsp=Slider(0.8, range=0..1))  # -> EPMaterial; plug-in component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
epopaquemat_2 = Honeybee_EnergyPlusOpaqueMaterial(
    name="SIA380_insulation_exposed",
    thickness=number_slider_5,
    conductivity=number_slider_4,
    density=Slider(35, range=0..100),
    specificHeat=Slider(1450, range=0..10000),
    solAbsp=Slider(0.8, range=0..1))  # -> EPMaterial; plug-in component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
epopaquemat_3 = Honeybee_EnergyPlusOpaqueMaterial(
    name="wall_mass",
    thickness=Slider(0.2, range=0..1),
    conductivity=Slider(1.95, range=0..10),
    density=Slider(2240, range=0..10000),
    specificHeat=Slider(900, range=0..1000))  # -> EPMaterial; plug-in component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
u_value_3 = Panel(division_2)
u_value_4 = Panel(division)
epnomassmat = Honeybee_EnergyPlusNoMassOpaqueMaterial(name="SIA380grn", R_Value=one_over_x_2)  # -> EPMaterial; plug-in component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
lng = ListLength(List=buildings_breps)
series = Series(Start=0, Step=1, Count=lng)
int = Integer(graft(series))
createhbsrfs = Honeybee_createHBSrfs(geometry=separatebynormal.lookingUp, srfType=Slider(1, range=0..1), EPConstruction="SIA380-EXPOSED")  # -> readMe, simplify(HBSurface); plug-in component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
repeat = RepeatData(Data="bldg", Length=lng)  # -> graft(Data)
createhbsrfs_2 = Honeybee_createHBSrfs(geometry=separatebynormal.lookingDown, srfType=Slider(2, range=0..10), EPBC="Ground", EPConstruction="SIA380-GROUND")  # -> readMe, simplify(HBSurface); plug-in component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
createhbsrfs_3 = Honeybee_createHBSrfs(geometry=separatebynormal.lookingSide, srfType=Slider(0, range=0..100), EPConstruction="SIA380-EXPOSED")  # -> readMe, simplify(HBSurface); plug-in component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
join_4 = TextJoin(Text=[repeat, int])  # -> simplify(flatten(Result))
path_mapper = PathMapper(createhbsrfs_3.HBSurface, source="{A;B}", target="{A}")
toggle = BooleanToggle(True)

# ----
# NO MASS MATERIALS ARE NOT SUPPORTED FOR NOW
subtraction = Subtraction(A=1, B=reflectivity)
epconstruction = Honeybee_EnergyPlusConstruction(name="SIA380-exposed", layer_1=epopaquemat_2, layer_2=epopaquemat_3)  # -> EPConstruction; plug-in component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
epconstruction_2 = Honeybee_EnergyPlusConstruction(name="SIA380-ground-nomass", layer_1=epnomassmat)  # -> EPConstruction; plug-in component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
epconstruction_3 = Honeybee_EnergyPlusConstruction(name="SIA380-ground", layer_1=epopaquemat)  # -> EPConstruction; plug-in component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
path_mapper_2 = PathMapper(createhbsrfs.HBSurface, source="{A;B}", target="{A}")
path_mapper_3 = PathMapper(createhbsrfs_2.HBSurface, source="{A;B}", target="{A}")
buildings_breps_2 = Brep(buildings_breps)

epnomassmat_2 = Honeybee_EnergyPlusNoMassOpaqueMaterial(name="SIA380exp", R_Value=one_over_x, solAbsp=subtraction)  # -> EPMaterial; plug-in component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
createhbzones = Honeybee_createHBZones(name=simplify(graft(join_4)), HBSurfaces=[path_mapper_2, path_mapper_3, path_mapper], isConditioned=True)  # -> readMe, simplify(HBZone); plug-in component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

epconstruction_4 = Honeybee_EnergyPlusConstruction(name="SIA380-exposed-nomass", layer_1=epnomassmat_2)  # -> EPConstruction; plug-in component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
panel_3 = Panel(epconstruction_4)
solveadjc = Honeybee_SolveAdjacencies(HBZones=flatten(createhbzones.HBZone), removeCurrentAdjc=False, findAdjc=Toggle(True))  # -> readMe, HBZonesWADJ; plug-in component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

addtoeplibrary = Honeybee_AddToEnergyPlusLibrary(
    EPObject=[epconstruction_4, epconstruction_2, epconstruction_3, epconstruction],
    addToProjectLib=toggle,
    overwrite=toggle)  # -> readMe; plug-in component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
panel_4 = Panel(addtoeplibrary)
hbzones = Data(solveadjc.HBZonesWADJ)

# ----
# 4. Run simulation using HB Zones
hbzones_2 = Data(hbzones)
windows_settings = Panel("""0.4
0.5
1.0
0.0""")
occupancy_settings = Panel("""5
0""")
hbzones_3 = Data(hbzones_2)
directory_6 = FilePath(directory)
solver = Text(solver_path)
name_6 = Text(name)
citysim_runsimulation = Honeybee_CitySimRunSimulation(
    HBZones=flatten(hbzones_3),
    Windows=windows_settings,
    Occupancy=occupancy_settings,
    CSobjs=csobjs,
    dir=directory_6,
    name=name_6,
    Solver=solver,
    Write=Toggle(False),
    Run=Toggle(False))  # -> out; plug-in component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

# ----
# 5. Load results
toggle_2 = BooleanToggle(False)
toggle_3 = BooleanToggle(False)
directory_7 = FilePath(directory)
name_7 = Text(name)
hbzones_4 = Data(hbzones_2)
citysim_loadresults = Honeybee_CitySimLoadResults(dir=directory_7, name=name_7, yearly=toggle_2, HBZones=flatten(hbzones_4), Run=toggle_3)  # -> SW, H, C, Geometry; plug-in component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

not = GateNot(A=toggle_3)
python = GhPythonScript(Show=not, inGeom=buildings_breps_2)  # -> outGeom; inputs Show: Boolean, inGeom: GeometryBase
# ---------- python: Python ----------
"""Returns geometry depending on boolean status.
    Inputs:
        Show: Boolean
        inGeom: input geometry
    Output:
        a: output geometry"""

__author__ = "gperonato"
__version__ = "2019.02.25"

if Show:
    outGeom = inGeom
# ---------- end python ----------
preview_3 = CustomPreview(Geometry=python, Material=ColourSwatch(SwatchColor=RGB(168, 153, 153)))
hourly_heating_needs = Data(citysim_loadresults.H)
hourly_cooling_needs = Data(citysim_loadresults.C)
hourly_irradiances = Data(citysim_loadresults.SW)

# ----
# 7. Create a solar radiation map
crv = Curve(citysim_loadresults.Geometry)
hourly_values = Data(hourly_irradiances)
srf = Surface(crv)
ma = MassAddition(Input=hourly_values)  # -> Result, PartialResults
division_3 = Division(A=ma.Result, B=1000)
bnd = Bounds(Numbers=flatten(division_3))
dedomain = DeconstructDomain(Domain=bnd)  # -> Start, End
gradient = Gradient(
    LowerLimit=Slider(0, range=0..100),
    UpperLimit=dedomain.End,
    Parameter=division_3,
    stops=[0: RGB(0, 0, 255), 0.501: RGB(255, 255, 0), 0.847: RGB(255, 0, 0)])
preview_4 = CustomPreview(Geometry=srf, Shader=gradient)
